# Grasshopper definition curtain.gh (Grasshopper 1.0.7)
# plug-ins: Heteroptera, Triceratops, Weaverbird, Kangaroo2 Components

timer = Timer(TimerInterval=20, Target=rnd_vector)
rnd_vector = RandomVector(Number=1, Length=Domain(1, 5), isflat=True)
vec = VectorXYZ(XComponent=Slider(14.798, range=-10..20), YComponent=Slider(2.379, range=-5..25), ZComponent=Slider(0, range=-5..5))  # -> Vector, Length
vec_2 = Vector(vec.Vector)

pt = Point([Point(0, 0, 0), Point(0, 0, 40), Point(35, 0, 40), Point(35, 0, 0)])
conmesh = ConstructMesh(Vertices=pt, Faces={A=0, B=1, C=2, D=3})
refine = Refine(Mesh=conmesh, Level=Slider(5, range=0..7))
demesh = DeconstructMesh(Mesh=refine)  # -> Vertices, Faces, Colours, Normals
pdecon = Deconstruct(Point=demesh.Vertices)  # -> XComponent, YComponent, ZComponent
bnd = Bounds(Numbers=pdecon.ZComponent)
dedomain = DeconstructDomain(Domain=bnd)  # -> Start, End
equals = Equality(FirstNumber=pdecon.ZComponent, SecondNumber=dedomain.End)  # -> Equality, Inequality
cull = CullPattern(List=demesh.Vertices, CullPattern=equals.Equality)
Z = UnitZ(Factor=Slider(-9.81, range=-9.81..9.8))
edgelengths = EdgeLengths(Mesh=refine, LengthFactor=Slider(1, range=0..2), Strength=Slider(5000, range=0..5000))
anchor = Anchor(Point=cull, Strength=10000)
floor = Floor(Strength=Slider(220, range=0..1000))
sc = SphereCollide(Points=demesh.Vertices, Radius=Slider(1, range=0..10), Strength=Slider(656, range=0..1000))
show = Show(G=refine)
load = Load(Point=demesh.Vertices, ForceVector=Z, Weighting=1)
wind = Wind(Mesh=refine, WindVector=vec_2)
bouncysolver = BouncySolver(
    GoalObjects=[anchor, show, load, wind, edgelengths, floor, sc],
    Reset=Button(),
    Threshold=1e-15,
    Tolerance=0.01,
    Damping=0.99,
    Iterations=10,
    On=Toggle(True))  # -> I, V, O
mesh = Mesh(bouncysolver.O)
clean = CleanTree(RemoveNulls=True, RemoveInvalid=True, RemoveEmpty=False, Tree=mesh)
wbcatmullclark = WeaverbirdsCatmullClarkSubdivision(MeshCurves=clean, Level=Slider(3, range=0..10), SmoothNakedEdges=1)

mesh_2 = Mesh(Mesh=wbcatmullclark, DecimalAccuracy=3)
nickname = RelativePath()
serialize = SerializeObject(Object3d=mesh_2, Minify=False, Run=True)
writetxt = WriteTextFile(Path=nickname, FileName="curtain.json", Data=serialize, Write=Toggle(True))
